# Grasshopper definition FlatteningSidesForPrinting.gh (Grasshopper 1.0.7)

xz_faces = Geometry([<brep referenced from the Rhino model> x2])
yz = YZPlane(Origin=Point(0, 0, 0))
xz = XZPlane(Origin=Point(0, 0, 0))
yz_faces = Geometry([<brep referenced from the Rhino model> x2])
base = Geometry(<extrusion referenced from the Rhino model>)
rotate = Rotate(Geometry=xz_faces, Angle=1.570796327, Plane=yz)  # -> Geometry, Transform
project = Project(Geometry=base, Plane=PlaneXY(0, 0, 0))  # -> Geometry, Transform
rotate_2 = Rotate(Geometry=yz_faces, Angle=1.570796327, Plane=xz)  # -> Geometry, Transform
project_2 = Project(Geometry=rotate.Geometry, Plane=PlaneXY(0, 0, 0))  # -> Geometry, Transform
contour = Contour(Shape=project.Geometry, Point=Point(0, 0, 0), Direction=Vector(0, 0, 1), Distance=Slider(1, range=0..1))
project_3 = Project(Geometry=rotate_2.Geometry, Plane=PlaneXY(0, 0, 0))  # -> Geometry, Transform
contour_2 = Contour(Shape=project_3.Geometry, Point=Point(0, 0, 0), Direction=Vector(0, 0, 1), Distance=Slider(1, range=0..1))
contour_3 = Contour(Shape=project_2.Geometry, Point=Point(0, 0, 0), Direction=Vector(0, 0, 1), Distance=Slider(1, range=0..1))
