# Grasshopper definition L2_Task2.gh (Grasshopper 1.0.7)

# ---- group: Base - Internal Shape
cutout_base_segment = Slider(5, range=3..10)
cutout_base_radius = Slider(27, range=0..100)
pt = ConstructPoint(XCoordinate=0, YCoordinate=0, ZCoordinate=0)
pln = Plane(pt)
polygon = Polygon(Plane=pln, Radius=cutout_base_radius, Segments=cutout_base_segment, FilletRadius=Slider(37.275, range=0..360))  # -> Polygon, Length

# ---- group: Base - External Shape
pt_2 = ConstructPoint(XCoordinate=0, YCoordinate=0, ZCoordinate=0)
pln_2 = Plane(pt_2)
polygon_2 = Polygon(Plane=pln_2, Radius=Slider(37, range=0..100), Segments=Slider(6, range=3..10), FilletRadius=Slider(0, range=0..360))  # -> Polygon, Length

# ---- group: Top
object_height = Slider(123, range=1..200)
top_width = Slider(95, range=0..100)
Z = UnitZ(Factor=object_height)
pln_3 = Plane(Z)
polygon_3 = Polygon(Plane=pln_3, Radius=top_width, Segments=Slider(8, range=3..10), FilletRadius=Slider(0, range=0..360))  # -> Polygon, Length

# ----
area = Area(Geometry=polygon.Polygon)  # -> Area, Centroid
area_2 = Area(Geometry=polygon_3.Polygon)  # -> Area, Centroid
geo = Geometry([polygon.Polygon, polygon_3.Polygon, polygon_2.Polygon])
loft = Loft(Curves=geo, Options={Adjust=False, Closed=False, LoftEnds=0, LoftSimp=0, LoftType=0, Rebuild=10, Refit=0.01})
ln = Line(StartPoint=area.Centroid, EndPoint=area_2.Centroid)
twist = Twist(Geometry=loft, Axis=ln, Angle=Slider(-5, range=-12..100), Infinite=False, Rigid=False)
crv = Curve(ln)
sunion = SolidUnion(Preview=twist)
number_slider = Slider(8, range=3..10)
brep = Brep(sunion)
pframes = PerpFrames(Curve=crv, Count=number_slider, Align=True)  # -> Frames, Parameters
sec = BrepPlane(Brep=brep, Plane=pframes.Frames)  # -> Curves, Points
panel = Panel(pframes.Frames)
boundary = BoundarySurfaces(Edges=sec.Curves)
panel_2 = Panel(boundary)
item = ListItem(List=boundary, Index=flatten(0), Wrap=True)
crv_2 = Curve(<curve referenced from the Rhino model>)
hframes = HorizontalFrames(Curve=crv_2, Count=number_slider)  # -> Frames, Parameters
Z_2 = UnitZ(Factor=Slider(0, range=0..100))
series = Series(Start=0, Step=1, Count=number_slider)
movetoplane = MoveToPlane(Geometry=item, Plane=Z_2, Above=True, Below=True)  # -> Geometry, Transform
panel_3 = Panel(hframes.Frames)
X = UnitX(Factor=hframes.Frames)
pln_4 = Plane(hframes.Frames)
panel_4 = Panel(movetoplane.Geometry)
item_2 = ListItem(List=movetoplane.Geometry, Index=0, Wrap=True)
vec = Vector(pln_4)
move = Move(Geometry=item_2, Motion=X)  # -> Geometry, Transform
panel_5 = Panel(X)
orient = Orient(Geometry=item_2, Source=PlaneXY(0, 0, 0), Target=X)  # -> Geometry, Transform
wires = BrepWireframe(Brep=orient.Geometry, Density=-1)
join = JoinCurves(Curves=wires, Preserve=False)
boundary_2 = BoundarySurfaces(Edges=join)
textsrf = TextOnSurface(Text=series, Font="Sans Bold:no Italic:no", Height=Slider(15, range=0..100), Depth=0.4, BaseSurface=boundary_2)
