# Grasshopper definition M3.gh (Grasshopper 1.0.7)

panel = Panel("Base polygon")
# Top Section of Table
pl = ConstructPlane(Origin=Point(0, 0, 0), XAxis=Vector(1, 0, 0), YAxis=Vector(0, 1, 0))
deplane = DeconstructPlane(Plane=pl)  # -> Origin, XAxis, YAxis, ZAxis

number_slider = Slider(20, range=0..100)
number_slider_2 = Slider(40, range=0..100)
polygon = Polygon(Plane=pl, Radius=number_slider, Segments=Slider(10, range=0..10), FilletRadius=0)  # -> Polygon, Length
Z = UnitZ(Factor=number_slider_2)
line = LineSDL(Start=deplane.Origin, Direction=Vector(0, 0, 1), Length=number_slider_2)
extr = Extrude(Base=polygon.Polygon, Direction=Z)
twist = Twist(Geometry=extr, Axis=line, Angle=Slider(1, range=0..1), Infinite=False, Rigid=False)

pl_offset = PlaneOffset(BasePlane=pl, Offset=number_slider_2)
cyl = Cylinder(Base=pl_offset, Radius=Slider(30, range=0..100), Length=Slider(10, range=0..10))

devec = DeconstructVector(Vector=deplane.XAxis)  # -> XComponent, YComponent, ZComponent
brep = Brep(cyl)
brep_2 = Brep(twist)
multiplication = Multiplication(A=number_slider, B=Slider(2.9, range=0..10))
subtraction = Subtraction(A=number_slider_2, B=Slider(15, range=0..100))
cap = CapHoles(Brep=brep)
cap_2 = CapHoles(Brep=brep_2)
panel_2 = Panel("Lower Table Section/Branch")
addition = Addition(A=devec.XComponent, B=multiplication)
pt = ConstructPoint(XCoordinate=addition, YCoordinate=0, ZCoordinate=0)
pl_offset_2 = PlaneOffset(BasePlane=pl, Offset=Slider(5, range=0..10))
deplane_2 = DeconstructPlane(Plane=pl_offset_2)  # -> Origin, XAxis, YAxis, ZAxis
pl_2 = ConstructPlane(Origin=pt, XAxis=Vector(1, 0, 0), YAxis=Vector(0, 1, 0))
pl_offset_3 = PlaneOffset(BasePlane=pl_2, Offset=subtraction)

polygon_2 = Polygon(Plane=pl_offset_3, Radius=Slider(21, range=0..100), Segments=Slider(4, range=0..10), FilletRadius=0)  # -> Polygon, Length
Z_2 = UnitZ(Factor=Slider(24, range=0..100))
extr_2 = Extrude(Base=polygon_2.Polygon, Direction=Z_2)

pl_offset_4 = PlaneOffset(BasePlane=pl_offset_3, Offset=Slider(4, range=0..10))
deplane_3 = DeconstructPlane(Plane=pl_offset_4)  # -> Origin, XAxis, YAxis, ZAxis
brep_3 = Brep(extr_2)
angle = Angle(VectorA=deplane_3.Origin, VectorB=deplane_2.Origin)  # -> Angle, Reflex
cap_3 = CapHoles(Brep=brep_3)
ln = Line(StartPoint=deplane_3.Origin, EndPoint=deplane_2.Origin)
panel_3 = Panel(angle.Angle)
pipe = Pipe(Curve=ln, Radius=Slider(3.4, range=0..10), Caps=0)
cap_4 = CapHoles(Brep=pipe)
sunion = SolidUnion(Breps=flatten([cap, cap_2, cap_3, cap_4]))
panel_4 = Panel(sunion)
