# Grasshopper definition ParamPlanter.gh (Grasshopper 1.0.7)

planter_base_width_x = Slider(12, range=12..48)
planter_base_length_y = Slider(18, range=12..48)
planter_depth = Slider(6, range=6..20)
wood_width = Slider(2, range=2..10)

pt = ConstructPoint(XCoordinate=0, YCoordinate=0, ZCoordinate=0)
panel = Panel("Planter Outer Perimeter")
pl = ConstructPlane(Origin=pt, XAxis=Vector(1, 0, 0), YAxis=Vector(0, 1, 0))
point = ConstructPoint(XCoordinate=0, YCoordinate=0, ZCoordinate=wood_width)
planter_base = Rectangle(Plane=pl, XSize=planter_base_width_x, YSize=planter_base_length_y, Radius=0)  # -> Rectangle, Length
pl_2 = ConstructPlane(Origin=point, XAxis=Vector(1, 0, 0), YAxis=Vector(0, 1, 0))
subtraction = Subtraction(A=planter_base_length_y, B=wood_width)
multiplication = Multiplication(WoodWidth=wood_width, B=Slider(2, range=0..10))
planter_base_2 = BoxRectangle(Rectangle=planter_base.Rectangle, Height=wood_width)
subtraction_2 = Subtraction(A=planter_base_width_x, B=multiplication)
long_side_width = Subtraction(PlanterBaseLength=planter_base_length_y, B=multiplication)
short_side_1 = Rectangle(Plane=pl_2, XSize=planter_base_width_x, YSize=wood_width, Radius=0)  # -> Rectangle, Length
pt_2 = ConstructPoint(XCoordinate=0, YCoordinate=0, ZCoordinate=0)
pt_3 = ConstructPoint(XCoordinate=0, YCoordinate=wood_width, ZCoordinate=wood_width)
addition = Addition(A=subtraction_2, B=wood_width)
Y = UnitY(Factor=subtraction)
X = UnitX(Factor=addition)
pl_3 = ConstructPlane(Origin=pt_3, XAxis=Vector(1, 0, 0), YAxis=Vector(0, 1, 0))
short_side_1_box = BoxRectangle(Rectangle=short_side_1.Rectangle, Height=planter_depth)
long_side_1 = Rectangle(Plane=pl_3, XSize=wood_width, YSize=long_side_width, Radius=0)  # -> Rectangle, Length
move = Move(Geometry=short_side_1_box, Motion=Y)  # -> Geometry, Transform
long_side_1_box = BoxRectangle(Rectangle=long_side_1.Rectangle, Height=planter_depth)
move_2 = Move(Geometry=long_side_1_box, Motion=X)  # -> Geometry, Transform
long_side_2_geometry = Geometry(move_2.Geometry)
planter_base_geometry = Geometry(planter_base_2)
short_side_1geometry = Geometry(short_side_1_box)
long_side_1_geometry = Geometry(long_side_1_box)
short_side_2_geometry = Geometry(move.Geometry)
sunion = SolidUnion(Breps=[short_side_1geometry, planter_base_geometry, long_side_1_geometry, long_side_2_geometry, short_side_2_geometry])
