# Grasshopper definition PlanterWithJoints.gh (Grasshopper 1.0.7)

wood_thickness = Slider(0.5, range=0..10)
depth = Slider(4, range=0..100)
planter_base_length = Slider(6, range=6..30)
X = UnitX(Factor=wood_thickness)
Z = UnitZ(Factor=depth)
origin_pt = ConstructPoint(XCoordinate=0, YCoordinate=0, ZCoordinate=0)
X_2 = UnitX(Factor=planter_base_length)
neg = Negative(Value=X)
short_face_area = Multiplication(A=depth, B=planter_base_length)
long_face_area = Multiplication(A=depth, B=planter_base_length)
multiplication = Multiplication(A=planter_base_length, B=planter_base_length)
move = Move(Geometry=origin_pt, Motion=Z)  # -> Geometry, Transform
division = Division(A=planter_base_length, B=2)
ln = Line(StartPoint=origin_pt, EndPoint=move.Geometry)
move_2 = Move(Geometry=origin_pt, Motion=neg)  # -> Geometry, Transform
face_area_total = Addition(A=short_face_area, B=long_face_area)
num_teeth = Slider(4, range=0..10)
extr = Extrude(Base=ln, Direction=X_2)
addition = Addition(A=face_area_total, B=multiplication)
len = Length(Curve=ln)
ln_2 = Line(StartPoint=move_2.Geometry, EndPoint=origin_pt)
area = Area(Geometry=extr, UseTasks=True)  # -> Area, Centroid
Y = UnitY(Factor=division)
panel = Panel(addition)
division_2 = Division(A=len, B=num_teeth)
yz = YZPlane(Origin=area.Centroid)
division_3 = Division(A=num_teeth, B=2)
move_3 = Move(Geometry=area.Centroid, Motion=Y)  # -> Geometry, Transform
multiplication_2 = Multiplication(A=division_2, B=2)
Z_2 = UnitZ(Factor=division_2)
series = Series(Start=0, Step=multiplication_2, Count=division_3)
Z_3 = UnitZ(Factor=Z_2)
extr_2 = Extrude(Base=ln_2, Direction=Z_2)
Z_4 = UnitZ(Factor=series)
move_4 = Move(Geometry=extr_2, Motion=Z_3)  # -> Geometry, Transform
move_5 = Move(Geometry=move_4.Geometry, Motion=Z_4)  # -> Geometry, Transform
move_6 = Move(Geometry=extr_2, Motion=Z_4)  # -> Geometry, Transform
mirror = Mirror(Geometry=move_6.Geometry, Plane=yz)  # -> Geometry, Transform
join = BrepJoin(Breps=flatten([move_5.Geometry, mirror.Geometry, extr]))  # -> Breps, Closed
fmerge = MergeFaces(Brep=join.Breps)  # -> Breps, Before, After
Y_2 = UnitY(Factor=fmerge.Breps)
rev = Reverse(Vector=Y_2)
amp = Amplitude(Vector=rev, Amplitude=wood_thickness)
extr_3 = Extrude(Base=fmerge.Breps, Direction=amp)
debrep = DeconstructBrep(Brep=extr_3)  # -> Faces, Edges, Vertices
midpt = CurveMiddle(Curve=debrep.Edges)
lng = ListLength(List=flatten(midpt))
fillet = Slider(0, range=0..3)
division_4 = Division(A="360", B="4")
series_2 = Series(Start=0, Step=1, Count=lng)
series_3 = Series(Start=0, Step=division_4, Count="4")
filedge = FilletEdge(Shape=extr_3, Blend=0, Metric=0, Edges=series_2, Radii=fillet)
panel_2 = Panel(filedge)
planter_box_4_sides = Rotate(Geometry=filedge, Angle=degrees(series_3), Plane=move_3.Geometry)  # -> Geometry, Transform
sunion = SolidUnion(Breps=planter_box_4_sides.Geometry)
box = Box(sunion)
debrep_2 = DeconstructBrep(Brep=box)  # -> Faces, Edges, Vertices
Z_5 = UnitZ(Factor=wood_thickness)
panel_3 = Panel("Box base")
box_base_face = ListItem(List=debrep_2.Faces, Index=4, Wrap=True)
neg_2 = Negative(Value=Z_5)
extr_4 = Extrude(Base=box_base_face, Direction=neg_2)
